# Grasshopper definition AttractorCurve-01-Abstract.gh (Grasshopper 1.0.7)

# ---- group: get numbs curve
attractor_curve = Curve(<curve referenced from the Rhino model>)
evaluate_curve = EvaluateCurve(Curve=reparameterize(attractor_curve), Parameter=Slider(0.412, range=0..1))  # -> Point, Tangent, Angle
sphere = Sphere(Base=evaluate_curve.Point, Radius=Slider(0.382, range=0..1))

# ---- group: Create popuated rectangle
rectangle = Rectangle(Plane=PlaneXY(0, 0, 0), XSize=Slider(41, range=0..100), YSize=Slider(28, range=0..100), Radius=0)  # -> Rectangle, Length
populate_2d = Populate2D(Region=rectangle.Rectangle, Count=Slider(187, range=50..300), Seed=1)

# ----
vector_2pt = Vector2Pt(PointA=evaluate_curve.Point, PointB=populate_2d, Unitize=False)  # -> Vector, Length

# ---- group: filter by size
smaller_than = SmallerThan(FirstNumber=vector_2pt.Length, SecondNumber=Slider(5, range=0..20))  # -> SmallerThan, OrEqualTo
cull_pattern = CullPattern(List=vector_2pt.Vector, CullPattern=smaller_than.SmallerThan)
cull_pattern_2 = CullPattern(List=vector_2pt.Length, CullPattern=smaller_than.SmallerThan)
cull_pattern_3 = CullPattern(List=populate_2d, CullPattern=smaller_than.SmallerThan)

# ---- group: create arcs around the points
reverse = Reverse(Vector=cull_pattern)
square = Square(Value=cull_pattern_2)
division = Division(A="1", B=square)
graph_mapper = GraphMapper(
    division,
    x0=0,
    x1=1,
    y0=0,
    y1=1,
    container_name="Bezier",
    cpx=[0, 0.01108186133, 0.1730603278, 1],
    cpy=[0, 0.7293276787, 0.9936081171, 1])
amplitude = Amplitude(Vector=reverse, Amplitude=graph_mapper)
multiplication = Multiplication(A=amplitude, B=Slider(1.2, range=0..10))

# ----
line = Line(StartPoint=evaluate_curve.Point, EndPoint=cull_pattern_3)
circle = Circle(Plane=cull_pattern_3, Radius=multiplication)
vector_display = VectorDisplay(Anchor=cull_pattern_3, Vector=amplitude)
