# Grasshopper definition AttractorCurve-02-City.gh (Grasshopper 1.0.7)
# plug-ins: Bifocals, LunchBox

# ---- group: create grid
# create a few splines in Rhino
number_slider = Slider(25, range=10..100)
curve = Curve([<curve referenced from the Rhino model> x3])
hexagonal = Hexagonal(Plane=PlaneXY(0, 0, 0), Size=1, ExtentX=number_slider, ExtentY=number_slider)  # -> flatten(Cells), Points
bounding_box = BoundingBox(Content=curve, Plane=PlaneXY(0, 0, 0), UnionBox=True)  # -> Box, Box_2
bounding_box_2 = BoundingBox(Content=hexagonal.Cells, Plane=PlaneXY(0, 0, 0), UnionBox=True)  # -> Box, Box_2
map_to_surface = MapToSurface(Curve=hexagonal.Cells, Source=bounding_box_2.Box, Target=bounding_box.Box)

# ---- group: set offset for the streets
area = Area(Geometry=map_to_surface)  # -> Area, Centroid
pull_point = PullPoint(Point=area.Centroid, Geometry=curve, ClosestOnly=True)  # -> ClosestPoint, Distance
larger_than = LargerThan(FirstNumber=pull_point.Distance, SecondNumber=Slider(7, range=0..100))  # -> LargerThan, OrEqualTo
cull_pattern = CullPattern(List=map_to_surface, CullPattern=larger_than.LargerThan)
cull_pattern_2 = CullPattern(List=area.Centroid, CullPattern=larger_than.LargerThan)
cull_pattern_3 = CullPattern(List=pull_point.Distance, CullPattern=larger_than.LargerThan)

# ----
bounds = Bounds(Numbers=cull_pattern_3)
remap_numbers = RemapNumbers(Value=cull_pattern_3, Source=bounds, Target=Domain(0, 1))  # -> Mapped, Clipped
graph_mapper = GraphMapper(
    remap_numbers.Mapped,
    x0=0,
    x1=1,
    y0=0,
    y1=1,
    container_name="Bezier",
    cpx=[0, 0.1532990783, 0.8705630302, 1],
    cpy=[0.8994016647, 0.0460138917, 0.8784595728, 0.09836876392])
scale = Scale(Geometry=cull_pattern, Center=cull_pattern_2, Factor=graph_mapper)  # -> Geometry, Transform

construct_domain = ConstructDomain(DomainStart=Slider(3, range=0..10), DomainEnd=Slider(17, range=0..50))
graph_mapper_2 = GraphMapper(
    remap_numbers.Mapped,
    x0=0,
    x1=1,
    y0=0,
    y1=1,
    container_name="Bezier",
    cpx=[0, 0.4899219871, 0.5132282376, 1],
    cpy=[0.0553792119, 0.1129698753, 0.8825895786, 0.9297087193])
remap_numbers_2 = RemapNumbers(Value=remap_numbers.Mapped, Source=graph_mapper_2, Target=construct_domain)  # -> Mapped, Clipped
unit_z = UnitZ(Factor=remap_numbers_2.Mapped)

extrude = Extrude(Base=scale.Geometry, Direction=unit_z)
cap_holes = CapHoles(Brep=extrude)
object_bake = ObjectBake(
    BakeToggle=Button(),
    GeometryObjects=cap_holes,
    Layer="buildings",
    ObjectName="GH_Obj",
    ObjectColor=RGB(255, 255, 255),
    LayerColor=RGB(255, 255, 255))
