# Grasshopper definition AttractorCurve-03-Panels.gh (Grasshopper 1.0.7)
# plug-ins: LunchBox

# ---- group: create grid
rectangular = Rectangular(Plane=PlaneXY(0, 0, 0), SizeX="3.7", SizeY="3.7", ExtentX=Slider(13, range=10..20), ExtentY=Slider(15, range=10..20))  # -> Cells, Points
area = Area(Geometry=rectangular.Cells)  # -> Area, flatten(Centroid)

# ---- group: create circles
bounding_box = BoundingBox(Content=flatten(rectangular.Cells), Plane=PlaneXY(0, 0, 0), UnionBox=True)  # -> flatten(Box), Box_2
area_2 = Area(Geometry=bounding_box.Box)  # -> Area, Centroid
distance = Distance(PointA=area_2.Centroid, PointB=area.Centroid)  # -> flatten(Distance)
construct_domain = ConstructDomain(DomainStart=Slider(1, range=0..1), DomainEnd=Slider(0.3, range=0..1))
bounds = Bounds(Numbers=distance)
remap_numbers = RemapNumbers(Value=distance, Source=bounds, Target=construct_domain)  # -> Mapped, Clipped

# ---- group: create surface
number_slider = Slider(10, range=0..10)
surface = Surface(bounding_box.Box)
divide_surface = DivideSurface(Surface=surface, UCount=number_slider, VCount=number_slider)  # -> Points, Normals, Parameters
distance_2 = Distance(PointA=area_2.Centroid, PointB=flatten(divide_surface.Points))  # -> flatten(Distance)
construct_domain_2 = ConstructDomain(DomainStart=Slider(2.2, range=0..10), DomainEnd=Slider(0, range=0..100))
bounds_2 = Bounds(Numbers=distance_2)
remap_numbers_2 = RemapNumbers(Value=distance_2, Source=bounds_2, Target=construct_domain_2)  # -> Mapped, Clipped
square = Square(Value=remap_numbers_2.Mapped)
unit_z = UnitZ(Factor=square)
move = Move(Geometry=flatten(divide_surface.Points), Motion=unit_z)  # -> Geometry, Transform
surface_from_points = SurfaceFromPoints(Points=move.Geometry, UCount=expr("x+1", number_slider), Interpolate=False)

# ----
circle = Circle(Plane=area.Centroid, Radius=remap_numbers.Mapped)

project = Project(Curve=circle, Brep=surface_from_points, Direction=Vector(0, 0, 1))
surface_split = SurfaceSplit(Surface=surface_from_points, Curves=flatten(project))
list_item = ListItem(List=surface_split, Index=0, Wrap=True)
object_bake = ObjectBake(
    BakeToggle=Button(),
    GeometryObjects=list_item,
    Layer="GH_Bake",
    ObjectName="GH_Obj",
    ObjectColor=RGB(255, 255, 255),
    LayerColor=RGB(255, 255, 255))
