# Grasshopper definition FormFinding-CurvedWall.gh (Grasshopper 1.0.7)

# ---- group: VAR
wall_length = Slider(14, range=0..30)
number_of_points = Slider(17, range=0..30)
wall_height = Slider(4, range=0..10)
wall_deviation = Slider(1.18, range=0..3)
seed_bottom_of_wall = Slider(15, range=0..100)
wall_thickness = Slider(0.3, range=0..1)
seed_top_of_wall = Slider(60, range=0..100)

# ----
construct_domain = ConstructDomain(DomainStart=0, DomainEnd=wall_length)
range = Range(Domain=construct_domain, Steps=expr("x-1", number_of_points))
construct_point = ConstructPoint(XCoordinate=0, YCoordinate=0, ZCoordinate=0)
unit_x = UnitX(Factor=range)
point = Point(construct_point)
move = Move(Geometry=point, Motion=unit_x)  # -> Geometry, Transform
unit_z = UnitZ(Factor=wall_height)
move_2 = Move(Geometry=move.Geometry, Motion=unit_z)  # -> Geometry, Transform
points_high = Data(move_2.Geometry)
points_low = Data(move.Geometry)

construct_domain_2 = ConstructDomain(DomainStart=expr("-x", wall_deviation), DomainEnd=wall_deviation)
construct_domain_3 = ConstructDomain(DomainStart=expr("-x", wall_deviation), DomainEnd=wall_deviation)
random = Random(Range=construct_domain_2, Number=expr("x-1", number_of_points), Seed=seed_top_of_wall)
random_2 = Random(Range=construct_domain_3, Number=expr("x-1", number_of_points), Seed=seed_bottom_of_wall)
unit_y = UnitY(Factor=random)
unit_y_2 = UnitY(Factor=random_2)
move_3 = Move(Geometry=points_low, Motion=unit_y_2)  # -> Geometry, Transform
move_4 = Move(Geometry=points_high, Motion=unit_y)  # -> Geometry, Transform
nurbs_curve = NurbsCurve(Vertices=move_3.Geometry, Degree=3, Periodic=False)  # -> Curve, Length, Domain
nurbs_curve_2 = NurbsCurve(Vertices=move_4.Geometry, Degree=3, Periodic=False)  # -> Curve, Length, Domain
unit_y_3 = UnitY(Factor=wall_thickness)
loft = Loft(
    Curves=[nurbs_curve_2.Curve, nurbs_curve.Curve],
    Options={Adjust=False, Closed=False, LoftEnds=0, LoftSimp=0, LoftType=0, Rebuild=10, Refit=0.01})

extrude = Extrude(Base=loft, Direction=unit_y_3)
