# Grasshopper definition FormFinding-KineticWall.gh (Grasshopper 1.0.7)
# plug-ins: Kangaroo2 Components, MeshEdit Components

# ---- group: Variables
wall_height = Slider(7, range=0..10)
verical_split = Slider(8, range=0..10)
mesh_multiplier = Slider(7, range=0..10)
amplitude_max = Slider(0.74, range=0..1)
amplitude_min = Slider(0, range=0..100)
wall_width = Slider(11, range=0..30)

# ---- group: Create base mesh
unit_x = UnitX(Factor=1)
unit_z = UnitZ(Factor=1)
construct_plane = ConstructPlane(Origin=Point(0, 0, 0), XAxis=unit_x, YAxis=unit_z)
division = Division(A=wall_width, B=wall_height)
rectangle = Rectangle(Plane=construct_plane, XSize=wall_width, YSize=wall_height, Radius=0)  # -> Rectangle, Length
multiplication = Multiplication(A=division, B=verical_split)
u_count = Integer(multiplication)
v_count = Integer(verical_split)
divide_surface = DivideSurface(Surface=rectangle.Rectangle, UCount=u_count, VCount=v_count)  # -> flatten(Points), Normals, Parameters
multiplication_2 = Multiplication(A=u_count, B=mesh_multiplier)
multiplication_3 = Multiplication(A=v_count, B=mesh_multiplier)
mesh_surface = MeshSurface(Surface=rectangle.Rectangle, UCount=multiplication_2, VCount=multiplication_3, Overhang=True, Equalize=False)
pull_point = PullPoint(Point=divide_surface.Points, Geometry=rectangle.Rectangle, ClosestOnly=True)  # -> ClosestPoint, Distance
equality = Equality(FirstNumber=pull_point.Distance, SecondNumber=0)  # -> Equality, Inequality
deconstruct_mesh = DeconstructMesh(Mesh=mesh_surface)  # -> Vertices, Faces, Colours, Normals
face_normals = FaceNormals(Mesh=mesh_surface)  # -> Centers, Normals
mesh_explode = MeshExplode(Mesh=mesh_surface, Interpolate=False)
cull_pattern = CullPattern(List=divide_surface.Points, CullPattern=equality.Inequality)
cull_pattern_2 = CullPattern(List=divide_surface.Points, CullPattern=equality.Equality)
internal_points = Point(cull_pattern)
external_points = Point(cull_pattern_2)
closest_points = ClosestPoints(Point=internal_points, Cloud=face_normals.Centers, Count=4)  # -> ClosestPoint, flatten(CPIndex), Distance

# ----
custom_preview = CustomPreview(Geometry=rectangle.Rectangle, Material=ColourSwatch(SwatchColor=RGB(0, 0, 0)))

cull_index = CullIndex(List=mesh_explode, Indices=closest_points.CPIndex, Wrap=True)
combine_clean = CombineClean(Meshes=cull_index)
mesh_edges = MeshEdges(Mesh=combine_clean)  # -> NakedEdges, InteriorEdges, NonManifoldEdges
nakedvertices = NakedVertices(Mesh=combine_clean)  # -> ClothedIndex, NakedIndex, ClothedPts, NakedPts
point = Point(nakedvertices.NakedPts)
join_curves = JoinCurves(Curves=mesh_edges.NakedEdges, Preserve=False)
length = Length(Curve=join_curves)
sort_list = SortList(Keys=length, ValuesA=join_curves)  # -> Keys, ValuesA
cull_index_2 = CullIndex(List=sort_list.ValuesA, Indices="-1", Wrap=True)
points_without_the_external_points = Data(cull_index_2)
small_number = Slider(0.01, range=0..0.01)
pull_point_2 = PullPoint(Point=point, Geometry=graft(points_without_the_external_points), ClosestOnly=True)  # -> ClosestPoint, Distance
smaller_than = SmallerThan(FirstNumber=pull_point_2.Distance, SecondNumber=small_number)  # -> SmallerThan, OrEqualTo
cull_pattern_3 = CullPattern(List=pull_point_2.ClosestPoint, CullPattern=smaller_than.SmallerThan)

# ---- group: Create rings
param_viewer = ParamViewer(cull_pattern_3)
average = Average(Input=cull_pattern_3)  # -> flatten(ArithmeticMean)
sort_points = SortPoints(Points=average)  # -> Points, Indices
list_item = ListItem(List=param_viewer, Index=sort_points.Indices, Wrap=True)
replace_paths = ReplacePaths(Data=cull_pattern_3, Search=list_item, Replace=param_viewer)
circle_fit = CircleFit(Points=replace_paths)  # -> Circle, Radius, Deviation
circles = Data(circle_fit.Circle)

# ---- group: Create springs
interior_edges_of_mesh = Line(mesh_edges.InteriorEdges)
external_spring_lines = Line(mesh_edges.NakedEdges)
length_2 = Length(Curve=external_spring_lines)
length_3 = Length(Curve=interior_edges_of_mesh)
multiplication_4 = Multiplication(A=length_2, B=Slider(0, range=0..1))
multiplication_5 = Multiplication(A=length_3, B=Slider(0, range=0..1))
length_line = LengthLine(Line=external_spring_lines, Length=multiplication_4, Strength=Slider(0.63, range=0..2))
length_line_2 = LengthLine(Line=interior_edges_of_mesh, Length=multiplication_5, Strength=Slider(0.41, range=0..2))
merge = Merge(Data1=length_line, Data2=length_line_2)

# ---- group: Create translated circles
deconstruct_plane = DeconstructPlane(Plane=construct_plane)  # -> Origin, XAxis, YAxis, ZAxis
list_length = ListLength(List=flatten(circles))
direction_of_move = Vector(deconstruct_plane.ZAxis)
merge_2 = Merge(Data1=amplitude_max, Data2=amplitude_min)
repeat_data = RepeatData(Data=merge_2, Length=list_length)
graft_tree = GraftTree(Tree=repeat_data, IncludeEmptyLists=True, IncludeNullItems=True)
amplitude = Amplitude(Vector=direction_of_move, Amplitude=graft_tree)
move = Move(Geometry=circles, Motion=amplitude)  # -> Geometry, Transform
circle_scale_value = Slider(0.54, range=0..1)
scale = Scale(Geometry=move.Geometry, Center=move.Geometry, Factor=circle_scale_value)  # -> Geometry, Transform

# ----
custom_preview_2 = CustomPreview(Geometry=scale.Geometry, Material=ColourSwatch(SwatchColor=RGB(0, 0, 0)))

# ---- group: Collect anchors
curve_closest_point = CurveClosestPoint(Point=replace_paths, Curve=scale.Geometry)  # -> Point, Parameter, Distance
anchor = Anchor(Point=external_points, Strength=10000)
anchor_2 = Anchor(Point=replace_paths, Target=curve_closest_point.Point, Strength=10000)
merge_3 = Merge(Data1=anchor, Data2=anchor_2)

# ---- group: Kangaroo
kangaroo_anchor_points = Data(merge_3)
kangaroo_springs = Data(merge)
show = Show(G=combine_clean)
entwine = Entwine(Branch00=kangaroo_springs, Branch01=kangaroo_anchor_points, Branch02=show, FlattenInputs=True)
bouncysolver = BouncySolver(GoalObjects=entwine, Reset=Button(), Threshold=1e-15, Tolerance=0.0001, Damping=0.99, Iterations=10, On=Toggle(True))  # -> I, V, O
list_item_2 = ListItem(List=bouncysolver.O, Index="-1", Wrap=True)
custom_preview_3 = CustomPreview(Geometry=list_item_2, Material=ColourSwatch(SwatchColor=RGB(178, 181, 242)))
