# Grasshopper definition FormFinding-WavyWall.gh (Grasshopper 1.0.7)

# ---- group: Variables
wall_height = Slider(40, range=0..100)
wall_length = Slider(78, range=3..100)
wall_thickness = Slider(4, range=0..5)
number_of_waves = Slider(24, range=0..100)
horizontal_split = Slider(53, range=0..100)
number_of_offset_points = Slider(91, range=0..100)
min_wave_inset = Slider(0.3, range=0..1)
max_wave_inset = Slider(0.8, range=0..1)

# ---- group: Wall base point
construct_point = ConstructPoint(XCoordinate=0, YCoordinate=0, ZCoordinate=0)
unit_x = UnitX(Factor=1)
line_sdl = LineSDL(Start=construct_point, Direction=unit_x, Length=wall_length)
wall_base_line = Line(line_sdl)

# ---- group: Horizontal lines
construct_domain = ConstructDomain(DomainStart=0, DomainEnd=wall_height)
range = Range(Domain=construct_domain, Steps=number_of_waves)
unit_z = UnitZ(Factor=range)
move = Move(Geometry=wall_base_line, Motion=unit_z)  # -> Geometry, Transform

# ----
horizontal_lines = Line(move.Geometry)

# ---- group: split top bottom and internal points
divide_curve = DivideCurve(Curve=horizontal_lines, Count=horizontal_split, Kinks=False)  # -> simplify(Points), Tangents, Parameters
tree_statistics = TreeStatistics(Tree=divide_curve.Points)  # -> Paths, Length, Count
panel = Panel("""0
-1""")
cull_index = CullIndex(List=tree_statistics.Paths, Indices=panel, Wrap=True)
list_item = ListItem(List=tree_statistics.Paths, Index=panel, Wrap=True)
cull_index_2 = CullIndex(List=list_item, Indices=0, Wrap=True)
cull_index_3 = CullIndex(List=list_item, Indices=1, Wrap=True)
tree_branch = TreeBranch(Tree=divide_curve.Points, Path=cull_index_2, MaintainPaths=True)
tree_branch_2 = TreeBranch(Tree=divide_curve.Points, Path=cull_index_3, MaintainPaths=True)
tree_branch_3 = TreeBranch(Tree=divide_curve.Points, Path=cull_index, MaintainPaths=True)

# ----
internal_points = Point(tree_branch_3)
top_points = Point(tree_branch)
bottom_points = Point(tree_branch_2)

# ---- group: Create random interior points
seed = Slider(43, range=0..100)
loft = Loft(
    Curves=horizontal_lines,
    Options={Adjust=False, Closed=False, LoftEnds=0, LoftSimp=0, LoftType=0, Rebuild=10, Refit=0.01})
curve = Curve(loft)
count = Slider(65, range=0..100)
seed_2 = Slider(40, range=0..100)
populate_geometry = PopulateGeometry(Geometry=curve, Count=count, Seed=seed_2)
populate_geometry_2 = PopulateGeometry(Geometry=loft, Count=number_of_offset_points, Seed=seed, Points=populate_geometry)
pull_point = PullPoint(Point=internal_points, Geometry=populate_geometry_2, ClosestOnly=True)  # -> ClosestPoint, Distance

# ----
random_interior_points = Point(pull_point.ClosestPoint)

# ---- group: Create wavy lines fron the straight
vector_2pt = Vector2Pt(PointA=random_interior_points, PointB=internal_points, Unitize=False)  # -> Vector, Length
construct_domain_2 = ConstructDomain(DomainStart=Slider(0.9, range=0..3), DomainEnd=0)
deconstruct_vector = DeconstructVector(Vector=vector_2pt.Vector)  # -> XComponent, YComponent, ZComponent
bounds = Bounds(Numbers=vector_2pt.Length)
vector_xyz = VectorXYZ(XComponent=0, YComponent=0, ZComponent=deconstruct_vector.ZComponent)  # -> Vector, Length
remap_numbers = RemapNumbers(Value=vector_2pt.Length, Source=bounds, Target=construct_domain_2)  # -> Mapped, Clipped
amplitude = Amplitude(Vector=vector_xyz.Vector, Amplitude=remap_numbers.Mapped)
move_2 = Move(Geometry=internal_points, Motion=amplitude)  # -> simplify(Geometry), Transform
merge = Merge(Data1=bottom_points, Data2=move_2.Geometry, Data3=top_points)
nurbs_curve = NurbsCurve(Vertices=merge, Degree=3, Periodic=False)  # -> flatten(Curve), Length, Domain

# ----
wavy_curves = Curve(nurbs_curve.Curve)

data_dam = DataDam(DataA=wavy_curves, BufferDelay=10000000, BufferMode=0)
shift_list = ShiftList(List=wavy_curves, Shift="-1", Wrap=False)
shift_list_2 = ShiftList(List=wavy_curves, Shift="1", Wrap=False)
graft_tree = GraftTree(Tree=shift_list, IncludeEmptyLists=True, IncludeNullItems=True)
graft_tree_2 = GraftTree(Tree=shift_list_2, IncludeEmptyLists=True, IncludeNullItems=True)
merge_2 = Merge(Data1=graft_tree, Data2=graft_tree_2)
end_points = EndPoints(Curve=merge_2)  # -> Start, End
list_item_2 = ListItem(List=end_points.Start, Index=0, Wrap=True)
list_item_3 = ListItem(List=end_points.Start, Index=1, Wrap=True)
line = Line(StartPoint=list_item_2, EndPoint=list_item_3)
is_planar = IsPlanar(Surface=loft, Interior=True)  # -> Planar, Plane
point_on_curve = PointOnCurve(line, parameter=0.5)
length = Length(Curve=line)
construct_domain_3 = ConstructDomain(DomainStart=min_wave_inset, DomainEnd=max_wave_inset)
bounds_2 = Bounds(Numbers=length)
remap_numbers_2 = RemapNumbers(Value=length, Source=bounds_2, Target=construct_domain_3)  # -> Mapped, Clipped
deconstruct_plane = DeconstructPlane(Plane=is_planar.Plane)  # -> Origin, XAxis, YAxis, ZAxis
amplitude_2 = Amplitude(Vector=deconstruct_plane.ZAxis, Amplitude=remap_numbers_2.Mapped)
move_3 = Move(Geometry=point_on_curve, Motion=amplitude_2)  # -> Geometry, Transform
arc_3pt = Arc3Pt(PointA=list_item_2, PointB=move_3.Geometry, PointC=list_item_3)  # -> Arc, Plane, Radius

circular_arc = CircularArc(arc_3pt.Arc)

list_item_4 = ListItem(List=merge_2, Index=0, Wrap=True)
list_item_5 = ListItem(List=merge_2, Index=1, Wrap=True)
sweep2 = Sweep2(Rail1=list_item_4, Rail2=list_item_5, Sections=circular_arc, SameHeight=False)  # -> flatten(Brep)
amplitude_3 = Amplitude(Vector=deconstruct_plane.ZAxis, Amplitude=wall_thickness)
extrude = Extrude(Base=loft, Direction=amplitude_3)
brep_join = BrepJoin(Breps=sweep2)  # -> Breps, Closed
split_brep = SplitBrep(Brep=extrude, Cutter=brep_join.Breps)
bounding_box = BoundingBox(Content=split_brep, Plane=PlaneXY(0, 0, 0))  # -> Box, Box_2
volume = Volume(Geometry=bounding_box.Box)  # -> Volume, Centroid
sort_list = SortList(Keys=volume.Volume, ValuesA=split_brep)  # -> Keys, ValuesA
list_item_6 = ListItem(List=sort_list.ValuesA, Index=-1, Wrap=True)
merge_3 = Merge(Data1=brep_join.Breps, Data2=list_item_6)

brep_join_2 = BrepJoin(Breps=merge_3)  # -> Breps, Closed
custom_preview = CustomPreview(Geometry=brep_join_2.Breps, Material=ColourSwatch(SwatchColor=RGB(195, 196, 240)))
