# Grasshopper definition GenerativeDesign-04-EvolutionaryOptimization.gh (Grasshopper 1.0.7)

number_slider = Slider(400000, range=100000..500000)

number_slider_2 = Slider(30, range=0..100)  # disabled
panel = Panel("3")  # disabled
series = Series(Start=number_slider_2, Step=number_slider_2, Count=panel)  # disabled
cross_reference = CrossReference(
    ListD1=series,
    ListD2=series,
    ListD3=series,
    ListD4=series,
    ListC=series,
    ListD=series,
    ListE=series,
    ListF=series,
    CrossMode=1)  # -> ListD1, ListD2, ListD3, ListD4, ListC, ListD, ListE, ListF; disabled
merge = Merge(
    Data1=graft(cross_reference.ListD1),
    Data2=graft(cross_reference.ListD2),
    Data3=graft(cross_reference.ListD3),
    Data4=graft(cross_reference.ListD4),
    Data5=graft(cross_reference.ListC),
    Data6=graft(cross_reference.ListD),
    Data7=graft(cross_reference.ListE),
    Data8=graft(cross_reference.ListF))  # disabled

# ---- group: create a gene pool
gene_pool = GenePool(Decimals=0, Maximum=110, Minimum=1, Value=[110, 110, 13, 110, 12, 9, 110, 110])
# OPTIONEERING
number_of_floors = Integer(gene_pool)

# ---- group: numnerical description o designs
sort_list = SortList(Keys=number_of_floors)  # -> reverse(Keys), ValuesA
split_list = SplitList(List=number_of_floors, Index="4")  # -> ListA, ListB
list_item = ListItem(List=sort_list.Keys, Index=0, Wrap=True)
merge_2 = Merge(Data1=simplify(flatten(split_list.ListA)), Data2=simplify(flatten(list_item)), Data3=simplify(flatten(split_list.ListB)))

# ---- group: calculate area
panel_2 = Panel("23")
square = Square(Plane=PlaneXY(0, 0, 0), Size=panel_2, ExtentX="3", ExtentY="3")  # -> flatten(Cells), Points
multiplication = Multiplication(A=panel_2, B=panel_2)
mass_addition = MassAddition(Input=merge_2)  # -> Result, PartialResults
multiplication_2 = Multiplication(A=mass_addition.Result, B=multiplication)

# ---- group: DNA of building options
panel_3 = Panel("-")
text_join = TextJoin(Text=merge_2, Join=panel_3)
genome = Text(text_join)

# ---- group: construct a basic solar system
sphere = Sphere(Base=PlaneXY(0, 0, 0), Radius=700)
brep_plane = BrepPlane(Brep=sphere, Plane=PlaneXY(0, 0, 0))  # -> Curves, Points
surface_split = SurfaceSplit(Surface=sphere, Curves=brep_plane.Curves)
construct_point = ConstructPoint(XCoordinate=Slider(0.6, range=0..1), YCoordinate=Slider(0.9, range=0.5..1.5), ZCoordinate=0)
list_item_2 = ListItem(List=surface_split, Index=0, Wrap=True)
evaluate_surface = EvaluateSurface(Surface=reparameterize(list_item_2), Point=construct_point)  # -> Point, Normal, UDirection, VDirection, Frame
iso_curve = IsoCurve(Surface=reparameterize(list_item_2), UVPoint=construct_point)  # -> UIsocurve, VIsocurve
vector = Vector(evaluate_surface.Point)
reverse = Reverse(Vector=vector)
amplitude = Amplitude(Vector=reverse, Amplitude=300)
vector_display_ex = VectorDisplayEx(Point=evaluate_surface.Point, Vector=amplitude, Colour=ColourSwatch(SwatchColor=RGB(255, 255, 0)), Width=2)

# ----
text_split = TextSplit(Text=genome, Separators=panel_3)
heights = Integer(text_split)

# ---- group: calculate area
mass_addition_2 = MassAddition(Input=heights)  # -> Result, PartialResults
multiplication_3 = Multiplication(A="23", B="23")
multiplication_4 = Multiplication(A=mass_addition_2.Result, B=multiplication_3)

# ---- group: create geometry from mesh
number = Number(panel_2)
floor_height = Panel("4.5")
division = Division(A=number, B=2)
multiplication_5 = Multiplication(A=heights, B=floor_height)
construct_domain = ConstructDomain(DomainStart=expr("-x", division), DomainEnd=division)
area = Area(Geometry=square.Cells)  # -> Area, Centroid
domain_box = DomainBox(Base=area.Centroid, X=construct_domain, Y=construct_domain, Z=multiplication_5)
mesh_box = MeshBox(Base=domain_box, XCount="1", YCount="1", ZCount="1")

# ----
building_geometry = Geometry(mesh_box)

vector_2 = Vector(reverse)
mesh_shadow = MeshShadow(Mesh=building_geometry, Light=vector_2, Plane=PlaneXY(0, 0, 0))
path_mapper = PathMapper(mesh_shadow, source="{A;B;C;D}", target="{A;B;C}")
region_union = RegionUnion(Curves=path_mapper)
shadow = Curve(region_union)
area_2 = Area(Geometry=shadow)  # -> Area, Centroid
integer = Integer(area_2.Area)

park = Curve(<curve referenced from the Rhino model>)
neigh = Curve(<curve referenced from the Rhino model>)
region_intersection = RegionIntersection(CurvesA=shadow, CurvesB=park)
region_intersection_2 = RegionIntersection(CurvesA=shadow, CurvesB=neigh)
replace_nulls = ReplaceNulls(Items=region_intersection, Replacements=0)  # -> Items, Count
replace_nulls_2 = ReplaceNulls(Items=region_intersection_2, Replacements=0)  # -> Items, Count
area_3 = Area(Geometry=replace_nulls.Items)  # -> Area, Centroid
area_4 = Area(Geometry=replace_nulls_2.Items)  # -> Area, Centroid
park_area_int = Integer(area_3.Area)
neighbour_area_int = Integer(area_4.Area)

# ---- group: Metrics
neighbour_shadow = Panel(neighbour_area_int)
total_shadow = Panel(integer)
park_shadow = Panel(park_area_int)
total_area = Panel(multiplication_4)

# ----
number_2 = Number(park_area_int)

# ---- group: sunlight coefficients
area_5 = Area(Geometry=neigh)  # -> Area, Centroid
area_6 = Area(Geometry=park)  # -> Area, Centroid
subtraction = Subtraction(A=area_6.Area, B=park_shadow)
subtraction_2 = Subtraction(A=area_5.Area, B=neighbour_shadow)
division_2 = Division(A=subtraction_2, B=area_5.Area)
division_3 = Division(A=subtraction, B=area_6.Area)

# ----
multiplication_6 = Multiplication(A=division_3, B=total_area, C=division_2)
galapagos = Galapagos(fitness=fitness, gene=gene_pool)
fitness = Number(multiplication_6)

# ---- group: sort by total area : smallest first
group = Group(Objects=building_geometry)
neighbour_shadow_area = Integer(neighbour_shadow)
filtered_gemones = Text(genome)
park_shadow_area = Integer(park_shadow)
shadow_area = Integer(total_shadow)
total_area_2 = Integer(total_area)
geometry = Geometry(group)
sort_list_2 = SortList(
    Keys=flatten(total_area_2),
    ValuesGeometry=flatten(geometry),
    ValuesTotalShadow=flatten(shadow_area),
    ValuesParkShadow=flatten(park_shadow_area),
    ValuesHeighbourShadow=flatten(neighbour_shadow_area),
    ValuesFilteredGenomes=flatten(filtered_gemones))  # -> graft(Keys), reverse(ValuesGeometry), graft(ValuesTotalShadow), graft(ValuesParkShadow), graft(ValuesHeighbourShadow), flatten(ValuesFilteredGenomes)
neighbour_shadow_area_2 = Integer(sort_list_2.ValuesHeighbourShadow)
park_shadow_area_2 = Integer(sort_list_2.ValuesParkShadow)
shadow_area_2 = Integer(sort_list_2.ValuesTotalShadow)
total_area_3 = Integer(sort_list_2.Keys)
geometry_2 = Geometry(sort_list_2.ValuesGeometry)

# ----
sorted_genomes = Text(sort_list_2.ValuesFilteredGenomes)

# ---- group: sort by total area : smallest first (continued)
merge_3 = Merge(
    Data1=simplify(sorted_genomes),
    Data2=simplify(total_area_3),
    Data3=simplify(shadow_area_2),
    Data4=simplify(park_shadow_area_2),
    Data5=simplify(neighbour_shadow_area_2))

# ---- group: sort by total area : largest first
group_2 = Group(Objects=building_geometry)
neighbour_shadow_area_3 = Integer(neighbour_shadow)
filtered_gemones_2 = Text(genome)
park_shadow_area_3 = Integer(park_shadow)
shadow_area_3 = Integer(total_shadow)
total_area_4 = Integer(total_area)
geometry_3 = Geometry(group_2)
sort_list_3 = SortList(
    Keys=flatten(total_area_4),
    ValuesGeometry=flatten(geometry_3),
    ValuesTotalShadow=flatten(shadow_area_3),
    ValuesParkShadow=flatten(park_shadow_area_3),
    ValuesHeighbourShadow=flatten(neighbour_shadow_area_3),
    FilteredGenomes=flatten(filtered_gemones_2))  # -> reverse(graft(Keys)), reverse(ValuesGeometry), reverse(graft(ValuesTotalShadow)), reverse(graft(ValuesParkShadow)), reverse(graft(ValuesHeighbourShadow)), reverse(graft(FilteredGenomes))
neighbour_shadow_area_4 = Integer(sort_list_3.ValuesHeighbourShadow)
park_shadow_area_4 = Integer(sort_list_3.ValuesParkShadow)
shadow_area_4 = Integer(sort_list_3.ValuesTotalShadow)
total_area_5 = Integer(sort_list_3.Keys)
geometry_4 = Geometry(sort_list_3.ValuesGeometry)

# ---- group: matrix ot tower options
number_slider_3 = Slider(5, range=0..10)
square_2 = Square(Plane=PlaneXY(0, 0, 0), Size=300, ExtentX=number_slider_3, ExtentY=number_slider_3)  # -> Cells, Points
geometry_5 = Geometry(flatten(geometry_4))
points = Point(flatten(square_2.Points))
list_length = ListLength(List=points)
list_length_2 = ListLength(List=geometry_5)
minimum = Minimum(A=list_length_2, B=list_length)
shadow_2 = Curve(flatten(shadow))
split_list_2 = SplitList(List=geometry_5, Index=minimum)  # -> ListA, ListB
split_list_3 = SplitList(List=points, Index=minimum)  # -> ListA, ListB
split_list_4 = SplitList(List=shadow_2, Index=minimum)  # -> ListA, ListB
move = Move(Geometry=split_list_2.ListA, Motion=split_list_3.ListA)  # -> Geometry, Transform
move_2 = Move(Geometry=split_list_4.ListA, Motion=split_list_3.ListA)  # -> Geometry, Transform
boundary_surfaces = BoundarySurfaces(Edges=move_2.Geometry)
custom_preview = CustomPreview(Geometry=move.Geometry, Material=ColourSwatch(SwatchColor=RGB(128, 128, 255)))
custom_preview_2 = CustomPreview(Geometry=boundary_surfaces, Material=ColourSwatch(SwatchColor=RGB(66, 67, 62)))

# ----
sorted_genomes_2 = Text(sort_list_3.FilteredGenomes)

# ---- group: sort by total area : largest first (continued)
merge_4 = Merge(
    Data1=simplify(sorted_genomes_2),
    Data2=simplify(total_area_5),
    Data3=simplify(shadow_area_4),
    Data4=simplify(park_shadow_area_4),
    Data5=simplify(neighbour_shadow_area_4))

# ---- group: area labels
panel_4 = Panel("""Genome: 
Total Floor Area: 
Total Shadow Area: 
Park Shadow Area: 
Neighbour Shadow Area: """)
values = Data(merge_4)
concatenate = Concatenate(FragmentA=panel_4, FragmentB=values)
text_join_2 = TextJoin(Text=concatenate)
data = Data(flatten(text_join_2))
split_list_5 = SplitList(List=data, Index=minimum)  # -> ListA, ListB
text_tag_3d = TextTag3D(
    Location=split_list_3.ListA,
    Text=split_list_5.ListA,
    Size=10,
    Colour=ColourSwatch(SwatchColor=RGB(0, 0, 0)),
    Justification=1)
