# Grasshopper definition GenerativeDesign-05-Optioneering.gh (Grasshopper 1.0.7)

# ---- group: create a floors for the tubes
min_neighbour_shadow = Slider(0, range=0..1)
max_neighbour_shadow = Slider(0.3, range=0..1)
minimal_building_area = Slider(350000, range=300000..500000)
max_total_shadow = Slider(0.8, range=0..1)
max_park_shadow = Slider(0.8, range=0..1)
min_total_shadow = Slider(0.1, range=0..1)
min_park_shadow = Slider(0, range=0..1)
number_slider = Slider(25, range=0..100)
min_total_area = Slider(0, range=0..1)
max_total_area = Slider(0.3, range=0..1)
series = Series(Start=number_slider, Step=number_slider, Count=Slider(4, range=2..5))
cross_reference = CrossReference(
    ListD1=series,
    ListD2=series,
    ListD3=series,
    ListD4=series,
    ListC=series,
    ListD=series,
    ListE=series,
    ListF=series,
    CrossMode=1)  # -> ListD1, ListD2, ListD3, ListD4, ListC, ListD, ListE, ListF
merge = Merge(
    Data1=graft(cross_reference.ListD1),
    Data2=graft(cross_reference.ListD2),
    Data3=graft(cross_reference.ListD3),
    Data4=graft(cross_reference.ListD4),
    Data5=graft(cross_reference.ListC),
    Data6=graft(cross_reference.ListD),
    Data7=graft(cross_reference.ListE),
    Data8=graft(cross_reference.ListF))
number_of_floors = Integer(merge)

# ---- group: numnerical description o designs
sort_list = SortList(Keys=number_of_floors)  # -> reverse(Keys), ValuesValuesA
split_list = SplitList(List=number_of_floors, Index="4")  # -> ListA, ListB
list_item = ListItem(List=sort_list.Keys, Index=0, Wrap=True)
merge_2 = Merge(Data1=simplify(split_list.ListA), Data2=simplify(list_item), Data3=simplify(split_list.ListB))

# ---- group: pre-calculate area
panel = Panel("23")
square = Square(Plane=PlaneXY(0, 0, 0), Size=panel, ExtentX="3", ExtentY="3")  # -> flatten(Cells), Points
mass_addition = MassAddition(Input=merge_2)  # -> Result, PartialResults
multiplication = Multiplication(A=panel, B=panel)
multiplication_2 = Multiplication(A=mass_addition.Result, B=multiplication)

# ---- group: Pre-filter base on total area
areas = Number(flatten(multiplication_2))
larger_than = LargerThan(FirstNumber=areas, SecondNumber=minimal_building_area)  # -> LargerThan, OrEqualTo
text_join = TextJoin(Text=merge_2, Join="-")
cull_pattern = CullPattern(List=flatten(text_join), CullPattern=larger_than.LargerThan)
clean_tree = CleanTree(RemoveNulls=True, RemoveInvalid=True, RemoveEmpty=True, Tree=cull_pattern)

# ---- group: DNA of building options
genome = Text(graft(clean_tree))

# ---- group: construct a basic solar system
sphere = Sphere(Base=PlaneXY(0, 0, 0), Radius=700)
brep_plane = BrepPlane(Brep=sphere, Plane=PlaneXY(0, 0, 0))  # -> Curves, Points
surface_split = SurfaceSplit(Surface=sphere, Curves=brep_plane.Curves)
construct_point = ConstructPoint(XCoordinate=Slider(0.6, range=0..1), YCoordinate=Slider(0.9, range=0.5..1.5), ZCoordinate=0)
list_item_2 = ListItem(List=surface_split, Index=0, Wrap=True)
evaluate_surface = EvaluateSurface(Surface=reparameterize(list_item_2), Point=construct_point)  # -> Point, Normal, UDirection, VDirection, Frame
iso_curve = IsoCurve(Surface=reparameterize(list_item_2), UVPoint=construct_point)  # -> UIsocurve, VIsocurve
vector = Vector(evaluate_surface.Point)
reverse = Reverse(Vector=vector)
amplitude = Amplitude(Vector=reverse, Amplitude=300)
vector_display_ex = VectorDisplayEx(Point=evaluate_surface.Point, Vector=amplitude, Colour=ColourSwatch(SwatchColor=RGB(255, 255, 0)), Width=2)

# ----
text_split = TextSplit(Text=genome, Separators="-")
heights = Integer(text_split)

# ---- group: calculate area
mass_addition_2 = MassAddition(Input=heights)  # -> Result, PartialResults
multiplication_3 = Multiplication(A="23", B="23")
multiplication_4 = Multiplication(A=mass_addition_2.Result, B=multiplication_3)

# ---- group: create geometry from mesh
number = Number(panel)
floor_height = Panel("4.5")
division = Division(A=number, B=2)
multiplication_5 = Multiplication(A=heights, B=floor_height)
construct_domain = ConstructDomain(DomainStart=expr("-x", division), DomainEnd=division)
area = Area(Geometry=square.Cells)  # -> Area, Centroid
domain_box = DomainBox(Base=area.Centroid, X=construct_domain, Y=construct_domain, Z=multiplication_5)
mesh_box = MeshBox(Base=domain_box, XCount="1", YCount="1", ZCount="1")

# ----
building_geometry = Geometry(mesh_box)

vector_2 = Vector(reverse)
mesh_shadow = MeshShadow(Mesh=building_geometry, Light=vector_2, Plane=PlaneXY(0, 0, 0))
path_mapper = PathMapper(mesh_shadow, source="{A;B;C;D}", target="{A;B;C}")
region_union = RegionUnion(Curves=path_mapper)
shadow = Curve(region_union)
park = Curve(<curve referenced from the Rhino model>)
neigh = Curve(<curve referenced from the Rhino model>)
area_2 = Area(Geometry=shadow)  # -> Area, Centroid
region_intersection = RegionIntersection(CurvesA=shadow, CurvesB=park)
region_intersection_2 = RegionIntersection(CurvesA=shadow, CurvesB=neigh)
replace_nulls = ReplaceNulls(Items=region_intersection, Replacements=0)  # -> Items, Count
replace_nulls_2 = ReplaceNulls(Items=region_intersection_2, Replacements=0)  # -> Items, Count
integer = Integer(area_2.Area)
area_3 = Area(Geometry=replace_nulls.Items)  # -> Area, Centroid
area_4 = Area(Geometry=replace_nulls_2.Items)  # -> Area, Centroid
park_area_int = Integer(area_3.Area)
neighbour_area_int = Integer(area_4.Area)

# ---- group: Metrics
neighbour_shadow = Panel(neighbour_area_int)
total_shadow = Panel(integer)
total_area = Panel(multiplication_4)
park_shadow = Panel(park_area_int)

# ---- group: sort by total area : largest first
group = Group(Objects=building_geometry)
neighbour_shadow_area = Integer(neighbour_shadow)
filtered_genomes = Text(graft(clean_tree))
park_shadow_area = Integer(park_shadow)
shadow_area = Integer(total_shadow)
total_area_2 = Integer(total_area)
geometry = Geometry(group)
sort_list_2 = SortList(
    Keys=flatten(total_area_2),
    ValuesGeometry=flatten(geometry),
    ValuesTotalShadow=flatten(shadow_area),
    ValuesParkShadow=flatten(park_shadow_area),
    ValuesHeighbourShadow=flatten(neighbour_shadow_area),
    ValuesFilteredGenomes=flatten(filtered_genomes))  # -> reverse(graft(Keys)), reverse(ValuesGeometry), reverse(graft(ValuesTotalShadow)), reverse(graft(ValuesParkShadow)), reverse(graft(ValuesHeighbourShadow)), reverse(graft(ValuesFilteredGenomes))
geometry_2 = Geometry(sort_list_2.ValuesGeometry)
total_area_3 = Integer(sort_list_2.Keys)
shadow_area_2 = Integer(sort_list_2.ValuesTotalShadow)
park_shadow_area_2 = Integer(sort_list_2.ValuesParkShadow)
neighbour_shadow_area_2 = Integer(sort_list_2.ValuesHeighbourShadow)
sorted_genomes = Text(sort_list_2.ValuesFilteredGenomes)

# ---- group: build interface base
unit_y = UnitY(Factor=expr("-x", "250"))
line_sdl = LineSDL(Start=unit_y, Direction=unit_y, Length="250")
series_2 = Series(Start=0, Step="250", Count=4)
unit_x = UnitX(Factor=series_2)
neighbour_shadow_area_3 = Integer(neighbour_shadow_area_2)
axes = Curve(reparameterize(line_sdl))
park_shadow_area_3 = Integer(park_shadow_area_2)
shadow_area_3 = Integer(shadow_area_2)
total_area_4 = Integer(total_area_3)
move = Move(Geometry=axes, Motion=unit_x)  # -> Geometry, Transform
entwine = Entwine(
    Branch00=total_area_4,
    Branch01=shadow_area_3,
    Branch02=park_shadow_area_3,
    Branch03=neighbour_shadow_area_3,
    FlattenInputs=True)
unit_y_2 = UnitY(Factor=50)
bounds = Bounds(Numbers=entwine)
end_points = EndPoints(Curve=move.Geometry)  # -> Start, End
unit_y_3 = UnitY(Factor=5)
unit_y_4 = UnitY(Factor=-5)
move_2 = Move(Geometry=end_points.Start, Motion=unit_y_3)  # -> Geometry, Transform
move_3 = Move(Geometry=end_points.End, Motion=unit_y_4)  # -> Geometry, Transform
panel_2 = Panel("""Total Floor Area
Total Shadow Area
Park Shadow Area
Neighbour Shadow Area""")
move_4 = Move(Geometry=end_points.Start, Motion=unit_y_2)  # -> Geometry, Transform
deconstruct_domain = DeconstructDomain(Domain=bounds)  # -> flatten(Start), flatten(End)
colour_swatch = ColourSwatch(SwatchColor=RGB(0, 0, 0))
text_tag_3d = TextTag3D(Location=move_2.Geometry, Text=deconstruct_domain.Start, Size=15, Colour=colour_swatch, Justification=9)
text_tag_3d_2 = TextTag3D(Location=move_3.Geometry, Text=deconstruct_domain.End, Size=15, Colour=colour_swatch, Justification=3)
text_tag_3d_3 = TextTag3D(Location=move_4.Geometry, Text=panel_2, Size=15, Colour=colour_swatch, Justification=2)

# ----
remap_numbers = RemapNumbers(Value=entwine, Source=bounds, Target=Domain(0, 1))  # -> Mapped, Clipped
evaluate_curve = EvaluateCurve(Curve=graft(move.Geometry), Parameter=remap_numbers.Mapped)  # -> Point, Tangent, Angle
flip_matrix = FlipMatrix(Data=evaluate_curve.Point)
polyline = PolyLine(Vertices=flip_matrix, Closed=False)

# ---- group: minimum
merge_3 = Merge(Data1=min_total_area, Data2=min_total_shadow, Data3=min_park_shadow, Data4=min_neighbour_shadow)
evaluate_curve_2 = EvaluateCurve(Curve=move.Geometry, Parameter=merge_3)  # -> Point, Tangent, Angle
remap_numbers_2 = RemapNumbers(Value=merge_3, Source=Domain(0, 1), Target=flatten(bounds))  # -> Mapped, Clipped
concatenate = Concatenate(FragmentA="< ", FragmentB=remap_numbers_2.Mapped)
colour_swatch_2 = ColourSwatch(SwatchColor=RGB(128, 128, 255))
text_tag_3d_4 = TextTag3D(Location=evaluate_curve_2.Point, Text=concatenate, Size=15, Colour=colour_swatch_2, Justification=4)

# ---- group: maximum
merge_4 = Merge(Data1=max_total_area, Data2=max_total_shadow, Data3=max_park_shadow, Data4=max_neighbour_shadow)
evaluate_curve_3 = EvaluateCurve(Curve=move.Geometry, Parameter=merge_4)  # -> Point, Tangent, Angle
remap_numbers_3 = RemapNumbers(Value=merge_4, Source=Domain(0, 1), Target=flatten(bounds))  # -> Mapped, Clipped
concatenate_2 = Concatenate(FragmentA="< ", FragmentB=remap_numbers_3.Mapped)
text_tag_3d_5 = TextTag3D(Location=evaluate_curve_3.Point, Text=concatenate_2, Size=15, Colour=colour_swatch_2, Justification=4)

# ---- group: Filter by sliders
merge_5 = Merge(
    Data1=simplify(total_area_3),
    Data2=simplify(shadow_area_2),
    Data3=simplify(park_shadow_area_2),
    Data4=simplify(neighbour_shadow_area_2))
maximum_sliders = Number(graft(remap_numbers_3.Mapped))
minimum_sliders = Number(graft(remap_numbers_2.Mapped))
flip_matrix_2 = FlipMatrix(Data=merge_5)
larger_than_2 = LargerThan(FirstNumber=flip_matrix_2, SecondNumber=minimum_sliders)  # -> LargerThan, OrEqualTo
smaller_than = SmallerThan(FirstNumber=flip_matrix_2, SecondNumber=maximum_sliders)  # -> SmallerThan, OrEqualTo
flip_matrix_3 = FlipMatrix(Data=larger_than_2.OrEqualTo)
flip_matrix_4 = FlipMatrix(Data=smaller_than.OrEqualTo)
mass_multiplication = MassMultiplication(Input=flip_matrix_3)  # -> Result, PartialResults
mass_multiplication_2 = MassMultiplication(Input=flip_matrix_4)  # -> Result, PartialResults
neighbour_shadow_area_4 = Integer(neighbour_shadow_area_2)
park_shadow_area_4 = Integer(sort_list_2.ValuesParkShadow)
sorted_genomes_2 = Text(sorted_genomes)
multiplication_6 = Multiplication(A=mass_multiplication.Result, B=mass_multiplication_2.Result)
shadow_shape = Curve(shadow)
geometry_3 = Geometry(graft(geometry_2))
shadow_area_4 = Integer(shadow_area_2)
total_area_5 = Integer(total_area_3)
cull_pattern_2 = CullPattern(List=geometry_3, CullPattern=multiplication_6)
cull_pattern_3 = CullPattern(List=total_area_5, CullPattern=multiplication_6)
cull_pattern_4 = CullPattern(List=shadow_area_4, CullPattern=multiplication_6)
cull_pattern_5 = CullPattern(List=park_shadow_area_4, CullPattern=multiplication_6)
cull_pattern_6 = CullPattern(List=neighbour_shadow_area_4, CullPattern=multiplication_6)
cull_pattern_7 = CullPattern(List=sorted_genomes_2, CullPattern=multiplication_6)
cull_pattern_8 = CullPattern(List=shadow_shape, CullPattern=multiplication_6)
filtered_geometry = Geometry(flatten(cull_pattern_2))
merge_6 = Merge(
    Data1=simplify(cull_pattern_7),
    Data2=simplify(cull_pattern_3),
    Data3=simplify(cull_pattern_4),
    Data4=simplify(cull_pattern_5))
filtered_genomes_2 = Text(cull_pattern_7)
filtered_shadow_shape = Geometry(flatten(cull_pattern_8))

# ----
cull_pattern_9 = CullPattern(List=polyline, CullPattern=multiplication_6)

# ---- group: GRID matrix ot tower options
number_slider_2 = Slider(5, range=0..10)
square_2 = Square(Plane=PlaneXY(0, 0, 0), Size=300, ExtentX=number_slider_2, ExtentY=number_slider_2)  # -> Cells, Points
geometry_4 = Geometry(flatten(filtered_geometry))
points = Point(flatten(square_2.Points))
list_length = ListLength(List=points)
list_length_2 = ListLength(List=geometry_4)
minimum = Minimum(A=list_length_2, B=list_length)
split_list_2 = SplitList(List=filtered_geometry, Index=minimum)  # -> ListA, ListB
split_list_3 = SplitList(List=points, Index=minimum)  # -> ListA, ListB
split_list_4 = SplitList(List=filtered_shadow_shape, Index=minimum)  # -> ListA, ListB
neigh_2 = Curve(neigh)
park_2 = Curve(park)
move_5 = Move(Geometry=split_list_2.ListA, Motion=split_list_3.ListA)  # -> Geometry, Transform
move_6 = Move(Geometry=split_list_4.ListA, Motion=split_list_3.ListA)  # -> Geometry, Transform
move_7 = Move(Geometry=neigh_2, Motion=split_list_3.ListA)  # -> Geometry, Transform
move_8 = Move(Geometry=park_2, Motion=split_list_3.ListA)  # -> Geometry, Transform
boundary_surfaces = BoundarySurfaces(Edges=move_6.Geometry)  # -> flatten(Surfaces)
custom_preview = CustomPreview(Geometry=move_5.Geometry, Material=ColourSwatch(SwatchColor=RGB(128, 128, 255)))
custom_preview_2 = CustomPreview(Geometry=boundary_surfaces, Material=ColourSwatch(SwatchColor=RGB(66, 67, 62)))

# ---- group: GRID matrix ot tower options / area labels
clean_tree_2 = CleanTree(RemoveNulls=True, RemoveInvalid=True, RemoveEmpty=True, Tree=merge_6)
panel_3 = Panel("""Genome: 
Total Floor Area: 
Total Shadow Area: 
Park Shadow Area: 
Neighbour Shadow Area: """)
values = Data(clean_tree_2)
concatenate_3 = Concatenate(FragmentA=panel_3, FragmentB=values)
text_join_2 = TextJoin(Text=concatenate_3)
data = Data(flatten(text_join_2))
colour_swatch_3 = ColourSwatch(SwatchColor=RGB(0, 0, 0))
split_list_5 = SplitList(List=data, Index=minimum)  # -> ListA, ListB
text_tag_3d_6 = TextTag3D(Location=split_list_3.ListA, Text=split_list_5.ListA, Size=9, Colour=colour_swatch_3, Justification=1)

# ----
list_length_3 = ListLength(List=flatten(multiplication_2))
list_length_4 = ListLength(List=flatten(genome))
list_length_5 = ListLength(List=flatten(move_5.Geometry))
count_displayed_genomes = Integer(list_length_5)
count_total_genomes = Integer(list_length_3)
count_prefiltered_genomes = Integer(list_length_4)
concatenate_4 = Concatenate(
    Fragment_A="Fitered down to ",
    Fragment_B=count_prefiltered_genomes,
    A=" from ",
    B=count_total_genomes,
    C=" designs.",
    D=count_displayed_genomes,
    E=" number of designs are displayed.")
unit_y_5 = UnitY(Factor=-520)
text_tag_3d_7 = TextTag3D(Location=unit_y_5, Text=concatenate_4, Size=15, Colour=colour_swatch_2, Justification=1)

# ---- group: GRID matrix ot tower options (continued)
custom_preview_3 = CustomPreview(Geometry=[move_7.Geometry, move_8.Geometry], Material=colour_swatch_3)
